# Grasshopper definition Remap+Ranking_Internalised.gh (Grasshopper 1.0.7)
# plug-ins: Hops, Pufferfish

data = Data(Tree({1}: ["0.301182", "0.342825", "0.284495", "0.181715", "0.146827", "0.05615"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], {2}: ["3405.991345", "3502.110836", "3814.623091", "4403.491978", "5186.850109", "5678.610205"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], {3}: ["3531.819902", "3717.218651", "4086.491918", "4472.188433", "5015.663582", "5691.043978"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], {4}: ["0.007689", "0.005114", "0.007488", "0.017117", "0.014787", "0.035047"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], {5}: ["0", "0", "0", "0", "0", "0"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], {6}: ["0.006931", "0.010971", "0.006773", "0.002435", "0.002337", "0.002865"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], {7}: ["7.811251", "7.944987", "0", "11.5579", "0", "0"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], {8}: ["0.02299", "0.034569", "0.023609", "0.010901", "0.010626", "0.004203"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]))
series = Series(Start="1", Step=1, Count="8")
cull_index = CullIndex(List=series, Indices=expr("x-1", ["2", "3"]), Wrap=True)
tree_branch = TreeBranch(Tree=data, Path=cull_index, MaintainPaths=True)
tree_branch_2 = TreeBranch(Tree=data, Path=["3", "2"], MaintainPaths=True)
bounds = Bounds(Numbers=tree_branch_2)
deconstruct_domain = DeconstructDomain(Domain=bounds)  # -> Start, End
construct_domain = ConstructDomain(DomainStart=deconstruct_domain.End, DomainEnd=deconstruct_domain.Start)
bounds_2 = Bounds(Numbers=tree_branch)
remap_numbers = RemapNumbers(Value=tree_branch_2, Source=construct_domain, Target=Domain(0, 1))  # -> Mapped, Clipped
remap_numbers_2 = RemapNumbers(Value=tree_branch, Source=bounds_2, Target=Domain(0, 1))  # -> Mapped, Clipped
panel = Panel(bounds_2)
panel_2 = Panel(remap_numbers_2.Mapped)
flip_matrix = FlipMatrix(Data=remap_numbers.Mapped)
flip_matrix_2 = FlipMatrix(Data=remap_numbers_2.Mapped)
merge = Merge(Data1=flip_matrix, Data2=flip_matrix_2)
mass_addition = MassAddition(Input=merge)  # -> flatten(Result), PartialResults
bounds_3 = Bounds(Numbers=mass_addition.Result)
remap_numbers_3 = RemapNumbers(Value=mass_addition.Result, Source=bounds_3, Target=Domain(0, 1))  # -> Mapped, Clipped
graph_mapper = GraphMapper(remap_numbers_3.Mapped, x0=0, x1=1, y0=0, y1=1, container_name="Bezier", cpx=[0, 0.8399885893, 0, 1], cpy=[0, 0, 1, 1])
# Preview the classification
gradient = Gradient(LowerLimit=0, UpperLimit=1, Parameter=graph_mapper, stops=[0: RGB(0, 128, 0), 0.5: RGB(255, 255, 0), 1: RGB(255, 0, 0)])
smaller_than = SmallerThan(FirstNumber=graph_mapper, SecondNumber=Slider(0.3, range=0..1))  # -> SmallerThan, OrEqualTo
# Hexagon Curves
curve = Curve([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])
quick_graph = QuickGraph(mass_addition.Result, SortOrder=0)
data_2 = Data([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])
surface = Surface(curve)
custom_preview = CustomPreview(Geometry=data_2, Material=ColourSwatch(SwatchColor=RGB(215, 212, 173)))
custom_preview_2 = CustomPreview(Geometry=surface, Material=gradient)
dispatch = Dispatch(List=surface, DispatchPattern=smaller_than.SmallerThan)  # -> ListA, ListB
surface_2 = Surface(dispatch.ListA)
xy_plane = XYPlane(Origin=Point(0, 0, 0))
area = Area(Geometry=curve)  # -> Area, Centroid
area_2 = Area(Geometry=surface_2)  # -> Area, Centroid
region_union = RegionUnion(Curves=data_2, Plane=xy_plane)
# Keshava's Metrics
# Pedro's Metrics
# Mass to void ratio in hexagon
# Closest distance to healthcare
# Closest distance to Parks
panel_3 = Panel("""Hospital_beds_per_1000
Green_Energy_produced
Investment_Heath_GDP
Newborns
Population
Poverty_rate
Price_Index
Road_Accidents_yr
School_leavers_rate
Transportation_metro
Solid_waste_collection""")
# The least score hexagons
point_in_curve = PointInCurve(Point=area_2.Centroid, Curve=region_union)  # -> Relationship, Point
dispatch_2 = Dispatch(List=surface_2, DispatchPattern=point_in_curve.Relationship)  # -> ListA, ListB
# Amenities per capita
# number of education facilities per capita
# Area of Green Space per capita
# Area of commercial to residential in a hexagon
# Population density in hexagon
boolean_toggle = BooleanToggle(True)
# Pedro's Metric
pedro_s_metric = Slider(8, range=0..10)
surface_3 = Surface(dispatch_2.ListA)
# Pedro's Metric
pedro_s_metric_2 = Slider(10, range=0..10)
area_3 = Area(Geometry=surface_3)  # -> Area, Centroid
closest_point = ClosestPoint(Point=area_3.Centroid, Cloud=area.Centroid)  # -> ClosestPoint, CPIndex, Distance
tree_branch_3 = TreeBranch(Tree=merge, Path=closest_point.CPIndex, MaintainPaths=True)
stream_filter = StreamFilter(Gate=boolean_toggle, Stream0=tree_branch_3, Stream1=merge)
# Pedro's Metric
pedro_s_metric_3 = Slider(3, range=0..10)
# Pedro's Metric
pedro_s_metric_4 = Slider(1, range=0..10)
# Pedro's Metric
pedro_s_metric_5 = Slider(6, range=0..10)
# Keshava's Metric
number_slider = Slider(3, range=0..10)
# Pedro's Metric
pedro_s_metric_6 = Slider(9, range=0..10)
# Hops
panel_4 = Panel("2020")

# ----
# Select this to move the point
# across the city map
# Year of Prediction
year = Slider(2037, range=2000..2050)
point = Point(Point(3814.374522, 1680.829985, 0))

hops = Hops(
    Year_to_predict=panel_4,
    CacheResultsInMemory=False,
    CacheSolveResults=False,
    RemoteDefinitionLocation="http://127.0.0.1:5000/prediction",
    RemoteSolveVersion=(0, 1, 0))
hops_2 = Hops(
    Year_to_predict=year,
    CacheResultsInMemory=False,
    CacheSolveResults=False,
    RemoteDefinitionLocation="http://127.0.0.1:5000/prediction",
    RemoteSolveVersion=(0, 1, 0))

# ----
# ML Prediction
panel_5 = Panel(hops)
panel_6 = Panel(hops_2)

list_item = ListItem(List=stream_filter, Index=Slider(4, range=0..10), Wrap=True)
# Amenities
# Parks
# Public Transport
data_3 = Data(Tree({1}: ["12", "12", "11", "8", "4", "3", "0", "0", "2", "9"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], {2}: ["2", "2", "2", "0", "0", "0", "0", "0", "0", "0"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], {3}: ["4", "4", "5", "11", "12", "12", "14", "14", "10", "7"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]))
split_list = SplitList(List=panel_5, Index="11")  # -> ListA, ListB
split_list_2 = SplitList(List=panel_6, Index="11")  # -> ListA, ListB
list_item_2 = ListItem(List=split_list_2.ListA, Index=pedro_s_metric, Wrap=True)
list_item_3 = ListItem(List=split_list_2.ListA, Index=pedro_s_metric_2, Wrap=True)
panel_7 = Panel(list_item_3)

# ----
# 0. Change in Green Space for each hexagon
# Metric Number
# 1. Change in Ratio of Amenities per hexagon
# 2. Change in Public Transport per hexagon
number_slider_2 = Slider(5, range=0..5)

tree_branch_4 = TreeBranch(Tree=data, Path="8", MaintainPaths=False)
panel_8 = Panel(split_list.ListA)
list_item_4 = ListItem(List=panel_8, Index=pedro_s_metric, Wrap=True)
list_item_5 = ListItem(List=panel_8, Index=pedro_s_metric_2, Wrap=True)
division = Division(A=list_item_2, B=list_item_4)
division_2 = Division(A=list_item_3, B=list_item_5)
panel_9 = Panel(split_list_2.ListA)
number = Number(101826.6346)
multiplication = Multiplication(A=tree_branch_4, B=number)
multiplication_2 = Multiplication(A=division, B=list_item)
list_item_6 = ListItem(List=split_list_2.ListA, Index=pedro_s_metric_5, Wrap=True)
list_item_7 = ListItem(List=stream_filter, Index=number_slider, Wrap=True)
round = Round(Number=multiplication)  # -> Nearest, Floor, Ceiling
list_item_8 = ListItem(List=panel_8, Index=pedro_s_metric_5, Wrap=True)
list_item_9 = ListItem(List=split_list_2.ListA, Index=pedro_s_metric_4, Wrap=True)
list_item_10 = ListItem(List=stream_filter, Index=Slider(5, range=0..10), Wrap=True)
list_item_11 = ListItem(List=panel_8, Index=pedro_s_metric_4, Wrap=True)
panel_10 = Panel(list_item_7)
division_3 = Division(A=list_item_6, B=list_item_8)
list_item_12 = ListItem(List=split_list_2.ListA, Index=pedro_s_metric_6, Wrap=True)
list_item_13 = ListItem(List=panel_8, Index=pedro_s_metric_6, Wrap=True)
list_item_14 = ListItem(List=split_list_2.ListA, Index=pedro_s_metric_3, Wrap=True)
data_4 = Data(Tree({0}: ["Santo António"], {1}: ["Parque das Nações"], {2}: ["Marvila"], {3}: ["Ajuda"], {4}: ["Areeiro"], {5}: ["Santa Maria Maior"]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))

# ----
# Pedro's metrics
number_2 = Number(split_list_2.ListB)
number_3 = Number(split_list.ListB)
panel_11 = Panel(number_2)
# Budget graphs
panel_12 = Panel(number_3)
bounds_4 = Bounds(Numbers=panel_11)
bounds_5 = Bounds(Numbers=panel_12)
construct_domain_2 = ConstructDomain(DomainStart=0, DomainEnd="14")
construct_domain_3 = ConstructDomain(DomainStart=0, DomainEnd="14")
remap_numbers_4 = RemapNumbers(Value=panel_11, Source=bounds_4, Target=construct_domain_2)  # -> Mapped, Clipped
remap_numbers_5 = RemapNumbers(Value=panel_12, Source=bounds_5, Target=construct_domain_3)  # -> Mapped, Clipped
sort_text = SortText(Keys=flatten(data_4), Values=flatten(data_2), Culture=127)  # -> Keys, Values
panel_13 = Panel(remap_numbers_5.Mapped)
panel_14 = Panel(remap_numbers_4.Mapped)
surface_4 = Surface(sort_text.Values)
area_4 = Area(Geometry=surface_4)  # -> Area, Centroid
mass_addition_2 = MassAddition(Input=panel_13)  # -> Result, PartialResults
closest_point_2 = ClosestPoint(Point=point, Cloud=area_4.Centroid)  # -> ClosestPoint, CPIndex, Distance
gradient_2 = Gradient(LowerLimit=0, UpperLimit="14", Parameter=panel_14, stops=[0: RGB(0, 128, 0), 0.5: RGB(255, 255, 0), 1: RGB(255, 0, 0)])
mass_addition_3 = MassAddition(Input=panel_14)  # -> Result, PartialResults
panel_15 = Panel(mass_addition_2.Result)
list_item_15 = ListItem(List=sort_text.Keys, Index=closest_point_2.CPIndex, Wrap=True)  # -> flatten(Item)
custom_preview_3 = CustomPreview(Geometry=surface_4, Material=gradient_2)
panel_16 = Panel(mass_addition_3.Result)
panel_17 = Panel(list_item_15)

list_item_16 = ListItem(List=panel_8, Index=pedro_s_metric_3, Wrap=True)
number_4 = Number(simplify(graft(round.Nearest)))
division_4 = Division(A=list_item_9, B=list_item_11)
flip_matrix_3 = FlipMatrix(Data=data_3)
panel_18 = Panel(data_3)
division_5 = Division(A=list_item_12, B=list_item_13)
division_6 = Division(A=list_item_14, B=list_item_16)
# Population per hexagon
panel_19 = Panel(round.Nearest)
bounds_6 = Bounds(Numbers=panel_19)
remap_numbers_6 = RemapNumbers(Value=panel_19, Source=bounds_6, Target=Domain(0, 1))  # -> Mapped, Clipped
bounds_7 = Bounds(Numbers=flatten(panel_19))
# Predicted Increase in Educational Facilities pre Capita
panel_20 = Panel(multiplication_2)
multiplication_3 = Multiplication(A=division_3, B=panel_10)
list_item_17 = ListItem(List=flip_matrix_3, Index=Slider(2, range=0..2), Wrap=True)
multiplication_4 = Multiplication(A=division_4, B=list_item_10)
multiplication_5 = Multiplication(A=division_2, B=remap_numbers_6.Mapped)
multiplication_6 = Multiplication(A=division_6, B="23")
number_slider_3 = Slider(1000, range=0..1000)
mass_addition_4 = MassAddition(Input=multiplication_5)  # -> Result, PartialResults
tree_branch_5 = TreeBranch(Tree=list_item_17, Path=closest_point.CPIndex, MaintainPaths=True)
subtraction = Subtraction(A=panel_20, B=list_item)
remap_numbers_7 = RemapNumbers(Value=flatten(panel_19), Source=bounds_7, Target=Domain(0, 1))  # -> Mapped, Clipped
multiplication_7 = Multiplication(A=mass_addition_4.Result, B=number_slider_3)
# Predicted Ratio of Amenities per Capita
panel_21 = Panel(multiplication_3)
multiplication_8 = Multiplication(A=division_5, B=tree_branch_5)
panel_22 = Panel(subtraction)
panel_23 = Panel(multiplication_7)
# Predicted Increase in Green Space pre Capita
panel_24 = Panel(multiplication_4)
# Pred number of Public Transport
panel_25 = Panel(multiplication_8)
graph_mapper_2 = GraphMapper(remap_numbers_7.Mapped, x0=0, x1=1, y0=0, y1=1, container_name="Sigmoid-Logits", e=0.2467943281, t0=-100, t1=100)
# Change in Ratio of Amenities per Capita
subtraction_2 = Subtraction(A=panel_21, B=panel_10)
multiplication_9 = Multiplication(A=simplify(graft(round.Nearest)), B=panel_22)  # -> simplify(Result)
panel_26 = Panel(subtraction_2)
multiplication_10 = Multiplication(A=multiplication_5, B=number_slider_3)  # -> simplify(graft(Result))
subtraction_3 = Subtraction(A=panel_24, B=list_item_10)
subtraction_4 = Subtraction(A=panel_25, B=list_item_17)
# Predicted Increase in Educational Facilities for each hexagon
panel_27 = Panel(multiplication_9)
# Solid Waste Generation
panel_28 = Panel(multiplication_10)
# Change in Green Space per Capita
panel_29 = Panel(subtraction_3)
multiplication_11 = Multiplication(A=simplify(graft(round.Nearest)), B=panel_26)
subtraction_5 = Subtraction(A=multiplication_6, B="23")
surface_5 = Surface(curve)
bounds_8 = Bounds(Numbers=flatten(panel_28))
bounds_9 = Bounds(Numbers=flatten(panel_27))
# Change in Ratio of Amenities per hexagon
panel_30 = Panel(multiplication_11)
# Change in Requirement of Hospitals
panel_31 = Panel(subtraction_5)
# Change in Public Transport
panel_32 = Panel(subtraction_4)
multiplication_12 = Multiplication(A=simplify(graft(round.Nearest)), B=panel_29)
area_5 = Area(Geometry=surface_5)  # -> Area, Centroid
remap_numbers_8 = RemapNumbers(Value=flatten(panel_28), Source=bounds_8, Target=Domain(0, 1))  # -> Mapped, Clipped
remap_numbers_9 = RemapNumbers(Value=flatten(panel_27), Source=bounds_9, Target=Domain(0, 1))  # -> Mapped, Clipped
closest_point_3 = ClosestPoint(Point=point, Cloud=area_5.Centroid)  # -> ClosestPoint, CPIndex, Distance
# Change in Green Space for each hexagon
panel_33 = Panel(multiplication_12)
graph_mapper_3 = GraphMapper(remap_numbers_8.Mapped, x0=0, x1=1, y0=0, y1=1, container_name="Sigmoid-Logits", e=0.2467943281, t0=-100, t1=100)
graph_mapper_4 = GraphMapper(remap_numbers_9.Mapped, x0=0, x1=1, y0=0, y1=1, container_name="Sigmoid-Logits", e=0.2467943281, t0=-100, t1=100)
list_item_18 = ListItem(List=curve, Index=closest_point_3.CPIndex, Wrap=True)
round_to_decimal_place = RoundToDecimalPlace(NumberX=panel_30, DecimalPlace="2", RoundType=0)  # -> Rounded, Difference
bounds_10 = Bounds(Numbers=flatten(round_to_decimal_place.Rounded))
remap_numbers_10 = RemapNumbers(Value=flatten(round_to_decimal_place.Rounded), Source=bounds_10, Target=Domain(0, 1))  # -> Mapped, Clipped
bounds_11 = Bounds(Numbers=flatten(panel_32))
bounds_12 = Bounds(Numbers=flatten(panel_33))
remap_numbers_11 = RemapNumbers(Value=flatten(panel_33), Source=bounds_12, Target=Domain(0, 1))  # -> Mapped, Clipped
remap_numbers_12 = RemapNumbers(Value=flatten(panel_32), Source=bounds_11, Target=Domain(0, 1))  # -> Mapped, Clipped
graph_mapper_5 = GraphMapper(remap_numbers_10.Mapped, x0=0, x1=1, y0=0, y1=1, container_name="Bezier", cpx=[0, 0.25, 0.75, 1], cpy=[0, 0.25, 0.75, 1])
graph_mapper_6 = GraphMapper(remap_numbers_11.Mapped, x0=0, x1=1, y0=0, y1=1, container_name="Sigmoid-Logits", e=0.2467943281, t0=-100, t1=100)
graph_mapper_7 = GraphMapper(remap_numbers_12.Mapped, x0=0, x1=1, y0=0, y1=1, container_name="Sigmoid-Logits", e=0.7139804363, t0=-100, t1=100)
stream_filter_2 = StreamFilter(
    Gate=number_slider_2,
    Stream0=graph_mapper_6,
    Stream1=graph_mapper_5,
    Stream2=graph_mapper_7,
    Stream3=graph_mapper_4,
    Stream4=graph_mapper_3,
    Stream5=graph_mapper_2)
multiplication_13 = Multiplication(A=stream_filter_2, B=Slider(1000, range=0..1000))
gradient_3 = Gradient(
    LowerLimit=0,
    UpperLimit=1,
    Parameter=graph_mapper_2,
    stops=[0: RGB(0, 128, 0), 0.29: RGB(255, 255, 0), 0.624: RGB(255, 0, 0)])
gradient_4 = Gradient(LowerLimit=0, UpperLimit=1, Parameter=graph_mapper_4, stops=[0.15: RGB(255, 255, 255), 0.85: RGB(208, 0, 255)])
gradient_5 = Gradient(
    LowerLimit=0,
    UpperLimit=1,
    Parameter=graph_mapper_3,
    stops=[0.138: RGB(255, 255, 255), 0.307: RGB(255, 255, 255), 0.542: RGB(79, 55, 25)])
gradient_6 = Gradient(LowerLimit=0, UpperLimit=1, Parameter=flatten(graph_mapper_5), stops=[0.15: RGB(255, 130, 160), 0.85: RGB(220, 0, 40)])
gradient_7 = Gradient(
    LowerLimit=0,
    UpperLimit=1,
    Parameter=flatten(graph_mapper_6),
    stops=[0: RGB(0, 98, 0), 0.25: RGB(175, 255, 122), 0.5: RGB(255, 255, 255), 0.75: RGB(235, 235, 235), 1: RGB(255, 255, 255)])
gradient_8 = Gradient(
    LowerLimit=0,
    UpperLimit=1,
    Parameter=flatten(graph_mapper_7),
    stops=[0: RGB(0, 128, 0), 0.5: RGB(255, 255, 0), 1: RGB(255, 0, 0)])
stream_filter_3 = StreamFilter(
    Gate=number_slider_2,
    Stream0=gradient_7,
    Stream1=gradient_6,
    Stream2=gradient_8,
    Stream3=gradient_4,
    Stream4=gradient_5,
    Stream5=gradient_3)
# Plan or Bar graph?
boolean_toggle_2 = BooleanToggle(True)
construct_domain_4 = ConstructDomain(DomainStart=0, DomainEnd=Slider(18, range=0..100))
line_sdl = LineSDL(Start=area_5.Centroid, Direction=Vector(0, 0, 1), Length=multiplication_13)
rectangle = Rectangle(Plane=area_5.Centroid, XSize=construct_domain_4, YSize=construct_domain_4, Radius=0)  # -> Rectangle, Length
end_points = EndPoints(Curve=line_sdl)  # -> Start, graft(End)
unit_z = UnitZ(Factor=multiplication_13)
surface_6 = Surface(rectangle.Rectangle)
stream_filter_4 = StreamFilter(
    Gate=number_slider_2,
    Stream0=panel_33,
    Stream1=round_to_decimal_place.Rounded,
    Stream2=panel_32,
    Stream3=panel_27,
    Stream4=panel_28,
    Stream5=number_4)
xz_plane = XZPlane(Origin=end_points.End)
extrude = Extrude(Base=surface_6, Direction=unit_z)
tree_branch_6 = TreeBranch(Tree=simplify(stream_filter_4), Path=closest_point_3.CPIndex, MaintainPaths=True)
tree_branch_7 = TreeBranch(Tree=simplify(xz_plane), Path=closest_point_3.CPIndex, MaintainPaths=True)
data_5 = Data(flatten(stream_filter_4))
data_6 = Data(flatten(xz_plane))
cull_index_2 = CullIndex(List=data_5, Indices=closest_point_3.CPIndex, Wrap=True)
cull_index_3 = CullIndex(List=data_6, Indices=closest_point_3.CPIndex, Wrap=True)
stream_filter_5 = StreamFilter(Gate=boolean_toggle_2, Stream1=extrude)
xy_plane_2 = XYPlane(Origin=Point(0, 0, 0))
boolean_toggle_3 = BooleanToggle(True)
region_union_2 = RegionUnion(Curves=data_2, Plane=xy_plane_2)
text = Text("Arial")
bool = Boolean(False)
stream_filter_6 = StreamFilter(Gate=boolean_toggle_2, Stream0=surface_5, Stream1=stream_filter_5)
area_6 = Area(Geometry=stream_filter_6)  # -> Area, Centroid
c_script = CSharpScript(
    face=text,
    bold=bool,
    italics=boolean_toggle_3,
    size=Slider(12, range=0..100),
    content=flatten(cull_index_2),
    pl=flatten(cull_index_3))  # -> out, simplify(A); inputs face: String, bold: Boolean, italics: Boolean, size: Double, content: String, pl: Plane
# ---------- c_script: C# usings ----------
using System.IO;
using System.Linq;
using System.Data;
using System.Drawing;
using System.Reflection;
using System.Windows.Forms;
using System.Xml;
using System.Xml.Linq;
using System.Runtime.InteropServices;

using Rhino.DocObjects;
using Rhino.Collections;
using GH_IO;
using GH_IO.Serialization;
# ---------- c_script: C# ----------
    if(size == 0)
      size = 1;

    if(!string.IsNullOrEmpty(face) && size > 0 && !string.IsNullOrEmpty(content) &&
      pl.IsValid)
    {
      using (var doc = Rhino.RhinoDoc.CreateHeadless(null))
      {
        var te = doc.Objects.AddText(content, pl, size, face, bold, italics);
        var txt = doc.Objects.Find(te) as Rhino.DocObjects.TextObject;

        if(txt != null)
        {
          var tt = txt.Geometry as Rhino.Geometry.TextEntity;
          A = tt.Explode();
        }
      }
    }
# ---------- end c_script ----------
point_in_curve_2 = PointInCurve(Point=area_6.Centroid, Curve=region_union_2)  # -> Relationship, Point
c_script_2 = CSharpScript(
    face=text,
    bold=bool,
    italics=boolean_toggle_3,
    size=Slider(74, range=0..100),
    content=flatten(tree_branch_6),
    pl=flatten(tree_branch_7))  # -> out, simplify(A); inputs face: String, bold: Boolean, italics: Boolean, size: Double, content: String, pl: Plane; same code as c_script
panel_34 = Panel(point_in_curve_2.Relationship)
member_index = MemberIndex(Set=panel_34, Member="2")  # -> Index, Count
merge_2 = Merge(Data1=c_script.A, Data2=simplify(c_script_2.A))
list_item_19 = ListItem(List=stream_filter_6, Index=member_index.Index, Wrap=True)
list_item_20 = ListItem(List=stream_filter_3, Index=member_index.Index, Wrap=True)
stream_filter_7 = StreamFilter(Gate=boolean_toggle_2, Stream1=merge_2)
custom_preview_4 = CustomPreview(Geometry=list_item_19, Material=list_item_20)

# ---- group: RH_OUT:crvs
crv = Curve(stream_filter_7)
